# Grasshopper definition tokyo1.4.gh (Grasshopper 1.0.8)
# plug-ins: RhinoCodePluginGH, Heteroptera, Anemone, Noise 4D

rec = Rectangle({Plane=PlaneXY(20, 15, 0), Size=Domain2(u=-20..20, v=-15..15)})  # disabled
number_slider = Slider(249, range=0..1000)  # disabled
button = Button()  # disabled
number_slider_2 = Slider(1000, range=0..1000)  # disabled
panel = Panel("0")  # disabled
number_slider_3 = Slider(0, range=0..1)  # disabled
number_slider_4 = Slider(0, range=0..1)  # disabled
loop_start = LoopStart(Repeat=number_slider, Trigger=button, Data=rec)  # -> port, Counter, Data; disabled
lng = ListLength(List=loop_start.Data)  # disabled
random = Random(Range=lng, Number=1, Seed=loop_start.Counter)  # disabled
substrate = Substrate(Border=rec, Count=number_slider_2, Angles=number_slider_3, Deviation=number_slider_4, Seed=5)  # disabled
round = Round(Number=random)  # -> Nearest, Floor, Ceiling; disabled
cull_i = CullIndex(List=loop_start.Data, Indices=round.Nearest, Wrap=True)  # disabled
item = ListItem(List=loop_start.Data, Index=round.Nearest, Wrap=True)  # disabled
srfsplit = SurfaceSplit(Surface=rec, Curves=substrate)  # disabled
edges = BrepEdges(Brep=item)  # -> Naked, Interior, NonManifold; disabled
lng_2 = ListLength(List=edges.Naked)  # disabled
random_2 = Random(Range=lng_2, Number=1, Seed=loop_start.Counter)  # disabled
round_2 = Round(Number=random_2)  # -> Nearest, Floor, Ceiling; disabled
item_2 = ListItem(List=edges.Naked, Index=round_2.Nearest, Wrap=True)  # disabled
end = EndPoints(Curve=item_2)  # -> Start, End; disabled
subtraction = Subtraction(A=end.Start, B=end.End)  # disabled
vec = Vector(subtraction)  # disabled
domain = Domain(vec)  # disabled
random_3 = Random(Range=domain, Number=1, Seed=2)  # disabled
devec = DeconstructVector(Vector=vec)  # -> XComponent, YComponent, ZComponent; disabled
panel_3 = Panel("0")  # disabled
equals = Equality(FirstNumber=panel_3, SecondNumber=devec.XComponent)  # -> Equality, Inequality; disabled
vec_2 = VectorXYZ(XComponent=random_3, YComponent=0, ZComponent=0)  # -> Vector, Length; disabled
vec_3 = VectorXYZ(XComponent=0, YComponent=random_3, ZComponent=0)  # -> Vector, Length; disabled
item_3 = ListItem(List=equals.Inequality, Index=0, Wrap=True)  # disabled
filter = StreamFilter(Gate=item_3, Stream0=vec_2.Vector, Stream1=vec_3.Vector)  # disabled
move = Move(Geometry=item_2, Motion=filter)  # -> Geometry, Transform; disabled
toggle = BooleanToggle(False)  # disabled
srfsplit_2 = SurfaceSplit(Surface=item, Curves=move.Geometry)  # disabled
panel_4 = Panel("0")  # disabled
ins = InsertItems(List=cull_i, Item=srfsplit_2, Indices=panel_4, Wrap=toggle)  # disabled
loop_end = LoopEnd(port=loop_start.port, Exit=False, Data=ins, TimeOutVal=0, pausedState=False, state="Constant output")  # disabled
area = Area(Geometry=loop_end)  # -> Area, Centroid; disabled
sort = SortList(Keys=area.Area, ValuesA=loop_end)  # -> Keys, ValuesA; disabled
panel_5 = Panel("-1")  # disabled
item_4 = ListItem(List=sort.ValuesA, Index=panel_5, Wrap=True)  # disabled

numberofsections = Slider(4, range=0..10)
mainseed = Slider(333, range=0..1000)
geo = Geometry(<surface referenced from the Rhino model>)
subtraction_2 = Subtraction(A=numberofsections, B="1")
startinggen = Button()
loop_start_2 = LoopStart(N=subtraction_2, T=startinggen, D0=geo)  # -> port, Counter, Data, Data_2, Data_3
addition = Addition(A=mainseed, B=loop_start_2.Counter)
loop_start_3 = LoopStart(N=Slider(50, range=0..100), T=Button(), D0=loop_start_2.Data)  # -> port, Counter, Data, Data_2
panel_6 = Panel(loop_start_3.Counter)
item_5 = ListItem(List=loop_start_3.Data, Index=0, Wrap=True)

# ----
# Find a way to reduce delay when changing the seed, so that it doesn't start processing the new seed while you're still moving the slider.
event = EventGate(Data=addition)  # -> Data, IsNew
buffer = TimeBuffer(Data=event.Data, Ms="2000", UseThread=True)
filter_2 = StreamFilter(Gate=event.IsNew, Stream0=buffer, Stream1=event.Data)

int = Integer(Slider(4, range=0..10))
py3 = Python3Script(totRules=int, counter=loop_start_3.Counter)  # -> out, a
# ---------- py3: Python ----------
step = 1/(counter+2);
total = totRules - 1;


for i in range (0, total):
    print(str(i*step) + " to " + str((i+1)*step));

print(str(total*step) + " to 1");
# ---------- end py3 ----------
random_4 = Random(Range=Domain(0, 1), Number=Slider(1000, range=0..1000), Seed=addition)
addition_2 = Addition(A=loop_start_3.Counter, B="1")
item_6 = ListItem(List=random_4, Index=addition_2, Wrap=True)
fdom = FindDomain(Domains=py3.out, Number=item_6, Strict=False)  # -> Index, Neighbour
subtraction_3 = Subtraction(A=fdom.Index)
gate = StreamGate(Stream=item_5, Gate=subtraction_3)  # -> Target0, Target1, Target2, Target3
center = Center(Geometry=gate.Target0)  # -> Center, Dimension
center_2 = Center(Geometry=gate.Target1)  # -> Center, Dimension
center_3 = Center(Geometry=gate.Target2)  # -> Center, Dimension
pi = Pi(Factor="0.5")
pi_2 = Pi(Factor="0.5")
pi_3 = Pi(Factor="0.5")
Y = UnitY(Factor=1)
Y_2 = UnitY(Factor=1)
X = UnitX(Factor=1)
Y_3 = UnitY(Factor=1)
X_2 = UnitX(Factor=1)
rot3d = Rotate3D(Geometry=gate.Target0, Angle=pi, Center=center.Center, Axis=Y)  # -> Geometry, Transform
rot3d_2 = Rotate3D(Geometry=gate.Target1, Angle=pi_2, Center=center_2.Center, Axis=Y_2)  # -> Geometry, Transform
rot3d_3 = Rotate3D(Geometry=gate.Target1, Angle=pi_2, Center=center_2.Center, Axis=X)  # -> Geometry, Transform
rot3d_4 = Rotate3D(Geometry=gate.Target2, Angle=pi_3, Center=center_3.Center, Axis=Y_3)  # -> Geometry, Transform
rot3d_5 = Rotate3D(Geometry=gate.Target2, Angle=pi_3, Center=center_3.Center, Axis=X_2)  # -> Geometry, Transform
split = SplitBrep(Brep=gate.Target0, Cutter=rot3d.Geometry)  # -> flatten(Result)
split_2 = SplitBrep(Brep=gate.Target1, Cutter=rot3d_3.Geometry)  # -> flatten(Result)
split_3 = SplitBrep(Brep=gate.Target2, Cutter=rot3d_4.Geometry)  # -> flatten(Result)
split_4 = SplitBrep(Brep=split_2, Cutter=rot3d_3.Geometry)  # -> flatten(Result)
split_5 = SplitBrep(Brep=split_3, Cutter=rot3d_5.Geometry)  # -> flatten(Result)
ins_2 = InsertItems(List=loop_start_3.Data, Item=[split, split_4, split_5], Indices="-1", Wrap=True)

item_7 = ListItem(List=ins_2, Index=Slider(6, range=0..100), Wrap=Toggle(False))

cull_i_2 = CullIndex(List=ins_2, Indices="0", Wrap=True)
null = NullItem(Item=cull_i_2)  # -> NullFlags, InvalidFlags, Description
ins_3 = InsertItems(List=loop_start_3.Data_2, Item=gate.Target3, Indices="-1", Wrap=True)
not = GateNot(A=null.NullFlags)
cull = CullPattern(List=cull_i_2, CullPattern=not)
loop_end_2 = LoopEnd(port=loop_start_3.port, Exit=False, Data=cull, Data_2=ins_3, TimeOutVal=0, pausedState=False, state="Output last")  # -> D0, flatten(D1)

panel_7 = Panel("5")  # disabled
rectangle = Rectangle(Plane=PlaneXY(0, 0, 0), XSize=panel_7, YSize=panel_7, Radius=0)  # -> Rectangle, Length; disabled
sph = Sphere(Base=PlaneXY(0, 0, 0), Radius=1)  # disabled
panel_8 = Panel("20")  # disabled
number_slider_5 = Slider(0.618, range=0..1)  # disabled
number_slider_6 = Slider(0.163, range=0..1)  # disabled
arrrec = RectangularArray(Geometry=sph, Cell=rectangle.Rectangle, XCount=panel_8, YCount=panel_8)  # -> Geometry, Transform; disabled
number_slider_7 = Slider(5, range=0..100)  # disabled
number_slider_8 = Slider(1, range=0..100)  # disabled
center_4 = Center(Geometry=arrrec.Geometry)  # -> Center, Dimension; disabled
simplex = SimplexNoise(Values=center_4.Center, Time=number_slider_5, Scale=number_slider_6)  # disabled
dom = ConstructDomain(DomainStart=number_slider_8, DomainEnd=number_slider_7)  # disabled
bnd = Bounds(Numbers=simplex)  # disabled
remap = RemapNumbers(Value=simplex, Source=bnd, Target=dom)  # -> Mapped, Clipped; disabled
scale = Scale(Geometry=arrrec.Geometry, Center=center_4.Center, Factor=remap.Mapped)  # -> Geometry, Transform; disabled

null_2 = NullItem(Item=loop_end_2.D1)  # -> NullFlags, InvalidFlags, Description
not_2 = GateNot(A=null_2.NullFlags)
cull_2 = CullPattern(List=loop_end_2.D1, CullPattern=not_2)
cull_i_3 = CullIndex(List=cull_2, Indices="0", Wrap=True)
maximumtowerheight = Slider(30, range=0..100)
minimumtowerheight = Slider(10, range=0..100)
dom_2 = ConstructDomain(DomainStart=minimumtowerheight, DomainEnd=maximumtowerheight)
lng_3 = ListLength(List=cull_i_3)
random_5 = Random(Range=dom_2, Number=lng_3, Seed=addition)
Z = UnitZ(Factor=random_5)
extr = Extrude(Base=cull_i_3, Direction=Z)
boxprop = BoxProperties(Box=extr)  # -> Center, Diagonal, Area, Volume, Degeneracy
devec_2 = DeconstructVector(Vector=boxprop.Diagonal)  # -> XComponent, YComponent, ZComponent
fillerheighttolerance = Slider(13, range=0..100)
extremes = MinMax(Number=devec_2.ZComponent)  # -> Minimum, Maximum
subtraction_4 = Subtraction(A=extremes.Maximum, B=devec_2.ZComponent)
smaller = SmallerThan(FirstNumber=subtraction_4, SecondNumber=fillerheighttolerance)  # -> SmallerThan, OrEqualTo
cull_3 = CullPattern(List=subtraction_4, CullPattern=smaller.SmallerThan)
cull_4 = CullPattern(List=extr, CullPattern=smaller.SmallerThan)
Z_2 = UnitZ(Factor=cull_3)
debrep = DeconstructBrep(Brep=cull_4)  # -> simplify(Faces), Edges, Vertices
item_8 = ListItem(List=debrep.Faces, Index=Slider(5, range=0..10), Wrap=True)
extr_2 = Extrude(Base=flatten(item_8), Direction=Z_2)
# This is done as to not exclude the tallest tower, which is "forgotten" in this extrusion step due to its extrusion height being 0.
null_3 = NullItem(Item=extr_2)  # -> NullFlags, InvalidFlags, Description
not_3 = GateNot(A=null_3.NullFlags)
cull_5 = CullPattern(List=extr_2, CullPattern=not_3)
bbox = BoundingBox(Content=[cull_5, cull_4], Plane=PlaneXY(0, 0, 0), UnionBox=True)  # -> Box, Box_2
debrep_2 = DeconstructBrep(Brep=bbox.Box)  # -> Faces, Edges, Vertices
facen = FaceNormals(Mesh=debrep_2.Faces)  # -> flatten(Centers), flatten(Normals)
Z_3 = UnitZ(Factor=1)
dprod = DotProduct(VectorA=Z_3, VectorB=facen.Normals, Unitize=False)
equals_2 = Equality(FirstNumber=dprod, SecondNumber="1")  # -> Equality, Inequality
number_slider_9 = Slider(0.078, range=0..1)
cull_6 = CullPattern(List=debrep_2.Faces, CullPattern=equals_2.Equality)
sectioncontractionlimit = Slider(0.7, range=0..2)
sectionexpansionlimit = Slider(1.5, range=0..2)
cluster = Cluster(
    noisetime=addition,
    noisescale=number_slider_9,
    startingarea=geo,
    sectionheight=extremes.Maximum,
    pointdensity=Slider(10, range=0..10),
    colorhuerange="1.3 to 1")  # -> B, M; disabled
center_5 = Center(Geometry=cull_6)  # -> Center, Dimension
preview = CustomPreview(Geometry=cluster.B, Material=cluster.M)  # disabled
simplex_2 = SimplexNoise(Values=center_5.Center, Time=addition, Scale=number_slider_9)
dom_3 = ConstructDomain(DomainStart=sectioncontractionlimit, DomainEnd=sectionexpansionlimit)
remap_2 = RemapNumbers(Value=simplex_2, Source="-1 to 1", Target=dom_3)  # -> Mapped, Clipped
pop2d = Populate2D(Region=cull_6, Count=Slider(1, range=0..10), Seed=addition)
scale_2 = Scale(Geometry=cull_6, Center=pop2d, Factor=remap_2.Mapped)  # -> Geometry, Transform
loop_end_3 = LoopEnd(
    port=loop_start_2.port,
    Exit=False,
    Floor=scale_2.Geometry,
    Towers=extr,
    Fillings=cull_5,
    TimeOutVal=0,
    pausedState=False,
    state="Last & Record")  # -> simplify(Floor), simplify(Towers), simplify(Fillings)
event_2 = EventGate(Data=loop_end_3.Fillings)  # -> Data, IsNew
distributemodules = Button()

explode = ExplodeObject(Object=loop_end_3.Towers, Recursive=False)  # -> flatten(Objects); disabled
debrep_3 = DeconstructBrep(Brep=explode)  # -> flatten(Faces), Edges, Vertices; disabled
facen_2 = FaceNormals(Mesh=explode)  # -> Centers, Normals; disabled
camera = CameraCrane(Refresh=True)  # -> Camera, Target, Lens, Up, HorizontalViewAngle, VerticalViewAngle, ScreenRatio, Frame; disabled
item_9 = ListItem(List=facen_2.Normals, Index=0, Wrap=True)  # -> flatten(Item); disabled
vec2pt = Vector2Pt(PointA=camera.Camera, PointB=item_9, Unitize=False)  # -> Vector, Length; disabled
number_slider_10 = Slider(90, range=0..100)  # disabled
angle = Angle(VectorA=item_9, VectorB=vec2pt.Vector)  # -> Angle, Reflex; disabled
deg = Degrees(Radians=angle.Angle)  # disabled
smaller_2 = SmallerThan(FirstNumber=deg, SecondNumber=number_slider_10)  # -> SmallerThan, OrEqualTo; disabled
larger = LargerThan(FirstNumber=deg, SecondNumber=number_slider_10)  # -> LargerThan, OrEqualTo; disabled
panel_9 = Panel(deg)  # disabled
cull_7 = CullPattern(List=debrep_3.Faces, CullPattern=larger.LargerThan)  # disabled
preview_2 = CustomPreview(
    Geometry=cull_7,
    Material={diffuse=RGB(221, 160, 221), emission=RGB(66, 48, 66), shine=0.5, specular=RGB(255, 255, 255), transparency=0})  # disabled

subtraction_5 = Subtraction(A=numberofsections, B="1")
geo_2 = Geometry(loop_end_3.Floor)
geo_3 = Geometry(loop_end_3.Towers)
geo_4 = Geometry(loop_end_3.Fillings)
loop_start_4 = LoopStart(N=subtraction_5, T=[event_2.IsNew, distributemodules])  # -> port, Counter, Data, Data_2
path = ConstructPath(Indices=loop_start_4.Counter)
path_2 = ConstructPath(Indices=loop_start_4.Counter)
branch = TreeBranch(Tree=loop_end_3.Towers, Path=path, MaintainPaths=True)
branch_2 = TreeBranch(Tree=loop_end_3.Fillings, Path=path_2, MaintainPaths=True)
debrep_4 = DeconstructBrep(Brep=branch)  # -> simplify(Faces), Edges, Vertices
debrep_5 = DeconstructBrep(Brep=branch_2)  # -> simplify(Faces), Edges, Vertices

# ----
# Removes top and bottom faces
panel_10 = Panel("4")
cull_i_4 = CullIndex(List=debrep_4.Faces, Indices=[panel_10, "5"], Wrap=True)  # -> simplify(List)

# ----
# Removes top and bottom faces
panel_11 = Panel("4")
cull_i_5 = CullIndex(List=debrep_5.Faces, Indices=[panel_11, "5"], Wrap=True)  # -> simplify(List)

int_2 = Integer()
int_3 = Integer()
splitmul = SplitBrepMultiple(Brep=cull_i_4, Cutters=flatten(cull_i_4))

# ----
# This area needs revision; could optimize the process by reducing the number of splits to make.
facen_3 = FaceNormals(Mesh=cull_i_4)  # -> Centers, Normals; disabled
debrep_6 = DeconstructBrep(Brep=branch)  # -> Faces, Edges, Vertices; disabled
unflatten = UnflattenTree(Tree=facen_3.Normals, Guide=cull_i_4)  # -> simplify(Tree); disabled
facen_4 = FaceNormals(Mesh=debrep_6.Faces)  # -> Centers, Normals; disabled
panel_12 = Panel(unflatten)  # disabled
unflatten_2 = UnflattenTree(Tree=facen_4.Normals, Guide=debrep_6.Faces)  # disabled
neg = Negative(Value=unflatten_2)  # disabled
graft = GraftTree(Tree=unflatten, IncludeEmptyLists=True, IncludeNullItems=True)  # disabled
panel_13 = Panel(graft)  # disabled
dprod_2 = DotProduct(VectorA=unflatten, VectorB=neg, Unitize=False)  # -> simplify(DotProduct); disabled
panel_14 = Panel("1")  # disabled
equals_3 = Equality(FirstNumber=dprod_2, SecondNumber=panel_14)  # -> Equality, Inequality; disabled
cull_8 = CullPattern(List=debrep_6.Faces, CullPattern=equals_3.Equality)  # -> simplify(List); disabled

center_6 = Center(Geometry=splitmul)  # -> Center, Dimension
scale_3 = Scale(Geometry=splitmul, Center=center_6.Center, Factor=Slider(0.9, range=0..1))  # -> Geometry, Transform
lng_4 = ListLength(List=flatten(scale_3.Geometry))
series = Series(Start=0, Step=1, Count=lng_4)
colmm = CollisionManyMany(Colliders=flatten(scale_3.Geometry))  # -> Collision, Indices
cull_9 = CullPattern(List=series, CullPattern=colmm.Collision)
replace = ReplaceItems(List=flatten(splitmul), Indices=cull_9, Wrap=False)
unflatten_3 = UnflattenTree(Tree=replace, Guide=splitmul)
trim = TrimTree(Tree=unflatten_3, Depth=1)
null_4 = NullItem(Item=trim)  # -> simplify(NullFlags), InvalidFlags, Description
not_4 = GateNot(A=null_4.NullFlags)
cull_10 = CullPattern(List=trim, CullPattern=not_4)

# ----
# Clean-up step to remove any empty branches created by towers with no visible faces.
prune = PruneTree(Tree=cull_10, Minimum="1", Maximum=0)

center_7 = Center(Geometry=prune)  # -> Center, Dimension
scale_4 = Scale(Geometry=prune, Center=center_7.Center, Factor=Slider(0.9, range=0..1))  # -> Geometry, Transform

# ----
# Flattening this input seems to stop invalid faces from passing through, but it also had a cascading effect of changing the random distribution of module pivots later on... I should investigate this further.
colom = CollisionOneMany(Collider=scale_4.Geometry, Obstacles=cull_i_5)  # -> Collision, Index

not_5 = GateNot(A=colom.Collision)
cull_11 = CullPattern(List=prune, CullPattern=not_5)
loop_end_4 = LoopEnd(port=loop_start_4.port, Exit=False, Data="1", Data_2=cull_11, TimeOutVal=0, pausedState=False, state="Constant & Record")  # -> D0, D1
numberofwallclasses = Slider(4, range=0..10)

# ----
# Horizontal
boxprop_2 = BoxProperties(Box=loop_end_4.D1)  # -> Center, Diagonal, Area, Volume, Degeneracy
devec_3 = DeconstructVector(Vector=boxprop_2.Diagonal)  # -> XComponent, YComponent, ZComponent
num = Number(devec_3.XComponent)
num_2 = Number(devec_3.YComponent)
weave = Weave(Pattern=[0, 1], Stream0=flatten(num), Stream1=flatten(num_2), NullGaps=False)
bool = Boolean(weave)
knob = ControlKnob(Decimals=2, Limit=True, Maximum=1, Minimum=0, Range=1, Value=0)
cull_12 = CullPattern(List=weave, CullPattern=bool)
knob_2 = ControlKnob(Decimals=2, Limit=True, Maximum=1, Minimum=0, Range=1, Value=0.16)
unflatten_4 = UnflattenTree(Tree=cull_12, Guide=devec_3.YComponent)
bnd_2 = Bounds(Numbers=flatten(unflatten_4))
series_2 = Series(Start=knob, Step=knob_2, Count=numberofwallclasses)
div = DivideDomain(Domain=bnd_2, Count=numberofwallclasses)
hsl = ColourHSL(Alpha=1, Hue=series_2, Saturation=1, Luminance=0.5)
material = CreateMaterial(Diffuse=hsl, Specular=RGB(255, 255, 255), Emission=RGB(0, 0, 0), Transparency=0, Shine=0)
fdom_2 = FindDomain(Domains=div, Number=unflatten_4, Strict=False)  # -> Index, Neighbour
item_10 = ListItem(List=material, Index=fdom_2.Index, Wrap=True)
Y_4 = UnitY(Factor=Slider(100, range=0..100))
move_2 = Move(Geometry=loop_end_4.D1, Motion=Y_4)  # -> Geometry, Transform
consec = ConsecutiveDomains(
    Numbers=[Slider(1, range=0..10), Slider(3, range=0..10), Slider(6, range=0..10), Slider(7, range=0..10), Slider(10, range=0..10)],
    Additive=Toggle(False))
preview_3 = CustomPreview(Geometry=move_2.Geometry, Material=item_10)
item_11 = ListItem(List=consec, Index=fdom_2.Index, Wrap=True)
lng_5 = ListLength(List=flatten(item_11))
random_6 = Random(Range=Domain(0, 1), Number=lng_5, Seed=mainseed)
remap_3 = RemapNumbers(Value=random_6, Source=Domain(0, 1), Target=flatten(item_11))  # -> Mapped, Clipped
round_3 = Round(Number=remap_3.Mapped)  # -> Nearest, Floor, Ceiling
unflatten_5 = UnflattenTree(Tree=round_3.Nearest, Guide=item_11)  # -> graft(Tree)

# ----
# Vertical
boxprop_3 = BoxProperties(Box=loop_end_4.D1)  # -> Center, Diagonal, Area, Volume, Degeneracy
devec_4 = DeconstructVector(Vector=boxprop_3.Diagonal)  # -> XComponent, YComponent, ZComponent
knob_3 = ControlKnob(Decimals=2, Limit=True, Maximum=1, Minimum=0, Range=1, Value=0)
knob_4 = ControlKnob(Decimals=2, Limit=True, Maximum=1, Minimum=0, Range=1, Value=0.16)
bnd_3 = Bounds(Numbers=flatten(devec_4.ZComponent))
series_3 = Series(Start=knob_3, Step=knob_4, Count=numberofwallclasses)
div_2 = DivideDomain(Domain=bnd_3, Count=numberofwallclasses)
hsl_2 = ColourHSL(Alpha=1, Hue=series_3, Saturation=1, Luminance=0.5)
material_2 = CreateMaterial(Diffuse=hsl_2, Specular=RGB(255, 255, 255), Emission=RGB(0, 0, 0), Transparency=0, Shine=0)
fdom_3 = FindDomain(Domains=div_2, Number=devec_4.ZComponent, Strict=False)  # -> Index, Neighbour
item_12 = ListItem(List=material_2, Index=fdom_3.Index, Wrap=True)
Y_5 = UnitY(Factor=Slider(50, range=0..100))
move_3 = Move(Geometry=loop_end_4.D1, Motion=Y_5)  # -> Geometry, Transform
consec_2 = ConsecutiveDomains(
    Numbers=[Slider(1, range=0..10), Slider(1, range=0..10), Slider(3, range=0..10), Slider(6, range=0..10), Slider(10, range=0..10)],
    Additive=Toggle(False))
preview_4 = CustomPreview(Geometry=move_3.Geometry, Material=item_12)
item_13 = ListItem(List=consec_2, Index=fdom_3.Index, Wrap=True)
lng_6 = ListLength(List=flatten(item_13))
random_7 = Random(Range=Domain(0, 1), Number=lng_6, Seed=mainseed)
remap_4 = RemapNumbers(Value=random_7, Source=Domain(0, 1), Target=flatten(item_13))  # -> Mapped, Clipped
round_4 = Round(Number=remap_4.Mapped)  # -> Nearest, Floor, Ceiling
unflatten_6 = UnflattenTree(Tree=round_4.Nearest, Guide=item_13)  # -> graft(Tree)

bbox_2 = BoundingBox(Content=loop_end_4.D1, Plane=PlaneXY(0, 0, 0))  # -> graft(Box), graft(Box_2)
dim = Dimensions(Surface=bbox_2.Box_2)  # -> UDimension, VDimension
dom² = ConstructDomain²(DomainU=dim.UDimension, DomainV=dim.VDimension)

number_slider_11 = Slider(2, range=0..10)  # disabled
number_slider_12 = Slider(2, range=0..10)  # disabled
number_slider_13 = Slider(2, range=0..10)  # disabled
pt = ConstructPoint(XCoordinate=0, YCoordinate=0, ZCoordinate=0)  # disabled
vec_4 = VectorXYZ(XComponent=number_slider_11, YComponent=number_slider_12, ZComponent=number_slider_13)  # -> Vector, Length; disabled
move_4 = Move(Geometry=pt, Motion=vec_4.Vector)  # -> Geometry, Transform; disabled
box = Box2Pt(PointA=pt, PointB=move_4.Geometry, Plane=PlaneXY(0, 0, 0))  # disabled
number_slider_14 = Slider(50, range=0..100)  # disabled
number_slider_15 = Slider(10, range=0..100)  # disabled
center_8 = Center(Geometry=box)  # -> Center, Dimension; disabled
number_slider_16 = Slider(0.2, range=0..10)  # disabled
number_slider_17 = Slider(1, range=0..10)  # disabled
number_slider_18 = Slider(1, range=0..10)  # disabled
arrbox = BoxArray(Geometry=center_8.Center, Cell=box, XCount=number_slider_15, YCount=number_slider_15, ZCount=number_slider_14)  # -> Geometry, Transform; disabled
pdecon = Deconstruct(Point=arrbox.Geometry)  # -> XComponent, YComponent, ZComponent; disabled
panel_15 = Panel("-0.5 to 0.5")  # disabled
multiplication = Multiplication(A=pdecon.XComponent, B=number_slider_17)  # disabled
multiplication_2 = Multiplication(A=pdecon.YComponent, B=number_slider_18)  # disabled
multiplication_3 = Multiplication(A=pdecon.ZComponent, B=number_slider_16)  # disabled
number_slider_19 = Slider(60, range=0..100)  # disabled
pt_2 = ConstructPoint(XCoordinate=multiplication, YCoordinate=multiplication_2, ZCoordinate=multiplication_3)  # disabled
box_2 = DomainBox(Base=arrbox.Geometry, X=panel_15, Y=panel_15, Z=panel_15)  # disabled
X_3 = UnitX(Factor=number_slider_19)  # disabled
move_5 = Move(Geometry=box_2, Motion=X_3)  # -> Geometry, Transform; disabled

divide = DivideDomain²(Domain=dom², UCount=Slider(1, range=0..10), VCount=unflatten_6)
subsrf = Isotrim(Surface=bbox_2.Box_2, Domain=divide)
trim_2 = TrimTree(Tree=subsrf, Depth=1)
sdivide = DivideSurface(Surface=reparameterize(trim_2), UCount=unflatten_5, VCount=Slider(2, range=0..10))  # -> Points, Normals, Parameters
wires = BrepWireframe(Brep=trim_2, Density=-1)
join = JoinCurves(Curves=wires, Preserve=False)
trim_3 = TrimTree(Tree=sdivide.Points, Depth=1)
trim_4 = TrimTree(Tree=sdivide.Parameters, Depth=1)
incurve = PointInCurve(Point=trim_3, Curve=join)  # -> Relationship, Point
windowmaxscaling = Slider(0.7, range=0..10)
windowminscaling = Slider(0.1, range=0..10)
equals_4 = Equality(FirstNumber=incurve.Relationship, SecondNumber="2")  # -> Equality, Inequality
dim_2 = Dimensions(Surface=join)  # -> UDimension, VDimension
cull_13 = CullPattern(List=trim_4, CullPattern=equals_4.Equality)  # -> simplify(List)
cull_14 = CullPattern(List=trim_3, CullPattern=equals_4.Equality)  # -> simplify(List)
bnd_4 = Bounds(Numbers=dim_2.UDimension)
dom_4 = ConstructDomain(DomainStart=windowminscaling, DomainEnd=windowmaxscaling)
pdecon_2 = Deconstruct(Point=cull_13)  # -> XComponent, YComponent, ZComponent
remap_5 = RemapNumbers(Value=dim_2.UDimension, Source=bnd_4, Target=dom_4)  # -> Mapped, Clipped
pt_3 = ConstructPoint(XCoordinate=pdecon_2.YComponent, YCoordinate=pdecon_2.XComponent, ZCoordinate=0)
geo_5 = Geometry(<brep referenced from the Rhino model>)
geo_6 = Geometry(<brep referenced from the Rhino model>)
geo_7 = Geometry(<brep referenced from the Rhino model>)
geo_8 = Geometry(<brep referenced from the Rhino model>)
geo_9 = Geometry(<brep referenced from the Rhino model>)
evalsrf = EvaluateSurface(Surface=reparameterize(join), Point=pt_3)  # -> Point, Normal, UDirection, VDirection, Frame
relay = Relay([geo_5, geo_6, geo_7, geo_8, geo_9])
lng_7 = ListLength(List=relay)
addition_3 = Addition(A=mainseed, B=Slider(0, range=0..10))
simplex_3 = SimplexNoise(Values=evalsrf.Frame, Time=addition_3, Scale=Slider(0.015, range=0..1))
div_3 = DivideDomain(Domain="-1 to 1", Count=lng_7)
fdom_4 = FindDomain(Domains=div_3, Number=simplex_3, Strict=False)  # -> Index, Neighbour
item_14 = ListItem(List=relay, Index=fdom_4.Index, Wrap=True)
box_3 = DomainBox(Base=evalsrf.Frame, X="-0.5 to 0.5", Y="-0.5 to 0.5", Z="-0.5 to 0.5")
box_4 = EvaluateBox(Box=item_14, UParameter=0.5, VParameter=0.5, WParameter=0.5)  # -> Plane, Point, Include
orient = Orient(Geometry=item_14, Source=box_4.Plane, Target=evalsrf.Frame)  # -> Geometry, Transform
dom_5 = ConstructDomain(DomainStart="0", DomainEnd=lng_7)
center_9 = Center(Geometry=orient.Geometry)  # -> Center, Dimension
remap_6 = RemapNumbers(Value=fdom_4.Index, Source=dom_5, Target=Domain(0, 1))  # -> Mapped, Clipped
scale_5 = Scale(Geometry=orient.Geometry, Center=center_9.Center, Factor=remap_5.Mapped)  # -> Geometry, Transform
hsl_3 = ColourHSL(Alpha=1, Hue=remap_6.Mapped, Saturation=1, Luminance=0.5)
material_3 = CreateMaterial(Diffuse=hsl_3, Specular=RGB(255, 255, 255), Emission=RGB(0, 0, 0), Transparency=0, Shine=0)
preview_5 = CustomPreview(Geometry=scale_5.Geometry, Material=material_3)
merge = Merge(Data1=scale_5.Geometry, Data3=geo_3, Data4=geo_4)

debrep_7 = DeconstructBrep(Brep=int_3)  # -> simplify(Faces), Edges, Vertices; disabled
panel_16 = Panel("5")  # disabled
debrep_8 = DeconstructBrep(Brep=int_3)  # -> Faces, Edges, Vertices; disabled
facen_5 = FaceNormals(Mesh=debrep_8.Faces)  # -> Centers, Normals; disabled
loop_start_5 = LoopStart(Repeat=0)  # -> port, Counter, Data; disabled
unflatten_7 = UnflattenTree(Tree=facen_5.Normals, Guide=debrep_8.Faces)  # disabled
loop_end_5 = LoopEnd(port=loop_start_5.port, Exit=False, TimeOutVal=0, pausedState=False, state="Constant output")  # disabled
neg_2 = Negative(Value=unflatten_7)  # disabled
panel_17 = Panel("1")  # disabled
cull_i_6 = CullIndex(List=int_3, Indices=int_2, Wrap=True)  # disabled
number_slider_20 = Slider(0.9, range=0..1)  # disabled
panel_18 = Panel("0")  # disabled

# ----
# Removes top and bottom faces
panel_19 = Panel("4")  # disabled
cull_i_7 = CullIndex(List=debrep_7.Faces, Indices=[panel_19, panel_16], Wrap=True)  # -> simplify(List); disabled

facen_6 = FaceNormals(Mesh=cull_i_7)  # -> Centers, Normals; disabled
unflatten_8 = UnflattenTree(Tree=facen_6.Normals, Guide=cull_i_7)  # -> simplify(Tree); disabled
dprod_3 = DotProduct(VectorA=flatten(unflatten_8), VectorB=flatten(neg_2), Unitize=False)  # -> simplify(DotProduct); disabled
equals_5 = Equality(FirstNumber=dprod_3, SecondNumber=panel_17)  # -> Equality, Inequality; disabled
cull_15 = CullPattern(List=debrep_8.Faces, CullPattern=equals_5.Equality)  # -> simplify(List); disabled
splitmul_2 = SplitBrepMultiple(Brep=debrep_7.Faces, Cutters=flatten(cull_15))  # disabled
center_10 = Center(Geometry=splitmul_2)  # -> Center, Dimension; disabled
scale_6 = Scale(Geometry=splitmul_2, Center=center_10.Center, Factor=number_slider_20)  # -> Geometry, Transform; disabled
colom_2 = CollisionOneMany(Collider=cull_i_6, Obstacles=simplify(graft(scale_6.Geometry)))  # -> Collision, Index; disabled
neg_3 = Negative(Value=colom_2.Collision)  # disabled
ma = MassAddition(Input=neg_3)  # -> flatten(Result), PartialResults; disabled
equals_6 = Equality(FirstNumber=panel_18, SecondNumber=ma.Result)  # -> Equality, Inequality; disabled
cull_16 = CullPattern(List=flatten(splitmul_2), CullPattern=equals_6.Equality)  # disabled

# ==== cluster Cluster
sectionheight = ClusterInput()
startingarea = ClusterInput()
Z = UnitZ(Factor=sectionheight)
dim = Dimensions(Surface=startingarea)  # -> UDimension, VDimension
extr = Extrude(Base=startingarea, Direction=Z)
addition = Addition(A=dim.UDimension, B=Slider(10, range=0..10))
X = UnitX(Factor=addition)
move = Move(Geometry=extr, Motion=X)  # -> Geometry, Transform
pointdensity = ClusterInput()
debrep = DeconstructBrep(Brep=move.Geometry)  # -> Faces, Edges, Vertices
item = ListItem(List=debrep.Vertices, Index=Slider(1, range=0..10), Wrap=True)
division = Division(A=dim.UDimension, B=pointdensity)
division_2 = Division(A=dim.VDimension, B=pointdensity)
division_3 = Division(A=sectionheight, B=pointdensity)
vec = VectorXYZ(XComponent=division, YComponent=division_2, ZComponent=division_3)  # -> Vector, Length
move_2 = Move(Geometry=item, Motion=vec.Vector)  # -> Geometry, Transform
addition_2 = Addition(A=pointdensity, B="1")
addition_3 = Addition(A=pointdensity, B="1")
addition_4 = Addition(A=pointdensity, B="1")
box = Box2Pt(PointA=item, PointB=move_2.Geometry, Plane=PlaneXY(0, 0, 0))
noisetime = ClusterInput()
noisescale = ClusterInput()
arrbox = BoxArray(Geometry=item, Cell=box, XCount=addition_2, YCount=addition_3, ZCount=addition_4)  # -> Geometry, Transform
colorhuerange = ClusterInput()
simplex = SimplexNoise(Values=arrbox.Geometry, Time=noisetime, Scale=noisescale)
remap = RemapNumbers(Value=simplex, Source="-1 to 1", Target=colorhuerange)  # -> Mapped, Clipped
remap_2 = RemapNumbers(Value=simplex, Source="-1 to 1", Target="0.3 to 0.3")  # -> Mapped, Clipped
box_2 = CenterBox(Base=arrbox.Geometry, X=remap_2.Mapped, Y=remap_2.Mapped, Z=remap_2.Mapped)
hsl = ColourHSL(Alpha=1, Hue=remap.Mapped, Saturation=1, Luminance=0.5)
material = CreateMaterial(Diffuse=hsl, Specular=RGB(255, 255, 255), Emission=RGB(0, 0, 0), Transparency=0, Shine=0)
B = ClusterOutput(box_2)
M = ClusterOutput(material)
